# Grasshopper definition edgedraw.gh (Grasshopper 1.0.7)
# plug-ins: ghgl

colour = ColourPicker(PickedColour=RGB(255, 239, 115))
brep = Brep(<brep referenced from the Rhino model>)
c_script = CSharpScript(meshes=brep)  # -> pos0, pos1, fn0, fn1; inputs meshes: list of Mesh
# ---------- c_script: C# ----------
    var _pos0 = new List<Point3d>();
    var _pos1 = new List<Point3d>();
    var _fn0 = new List<Vector3d>();
    var _fn1 = new List<Vector3d>();
    
    foreach( var mesh in meshes)
    {
      mesh.FaceNormals.ComputeFaceNormals();

      for( int i = 0; i < mesh.TopologyEdges.Count; i++ )
      {
        var pair = mesh.TopologyEdges.GetTopologyVertices(i);
        _pos0.Add(mesh.TopologyVertices[pair.I]);
        _pos1.Add(mesh.TopologyVertices[pair.J]);
        var faceIndices = mesh.TopologyEdges.GetConnectedFaces(i);
        _fn0.Add(mesh.FaceNormals[faceIndices[0]]);
        if( faceIndices.Length > 1 )
          _fn1.Add(mesh.FaceNormals[faceIndices[1]]);
        else
          _fn1.Add(new Vector3d());
      }
    }
    pos0 = _pos0;
    pos1 = _pos1;
    fn0 = _fn0;
    fn1 = _fn1;
# ---------- end c_script ----------
gl_shader = GLShader(
    Pos0=c_script.pos0,
    Pos1=c_script.pos1,
    Fn0=c_script.fn0,
    Fn1=c_script.fn1,
    Vcolor=colour,
    DepthTestingEnabled=False,
    DepthWritingEnabled=True,
    DrawMode=0,
    FragmentShader="""#version 330

in vec4 gs_color;

void main()
{
  gl_FragColor = gs_color;
}""",
    GLShader=(0, 1, 0),
    GeometryShader="""#version 330 core
layout (std140) uniform;

layout(points) in;
layout(line_strip, max_vertices = 2) out;

uniform mat4 _worldToClip;
uniform vec3 _cameraLocation;

in vec3 vs_position0[];
in vec3 vs_position1[];
in vec3 vs_normal0[];
in vec3 vs_normal1[];
in vec4 vs_color[];

out vec4 gs_color;

void main() {
  gs_color = vs_color[0];
  vec3 midpoint = (vs_position0[0]+vs_position1[0]) * 0.5;
  vec3 midToCam = normalize(_cameraLocation - midpoint);
  float d0 = dot(midToCam, vs_normal0[0]);
  float d1 = dot(midToCam, vs_normal1[0]);
  if( (d0 * d1) < 0 ) {
    vec4 po0 = _worldToClip*vec4(vs_position0[0],1);
    vec4 po1 = _worldToClip*vec4(vs_position1[0],1);
    gl_Position = po0;
    EmitVertex();
    gl_Position = po1;
    EmitVertex();
  }
  EndPrimitive();
}""",
    VertexShader="""#version 330

layout(location = 0) in vec3 pos0;
layout(location = 1) in vec3 pos1;
layout(location = 2) in vec3 fn0;
layout(location = 3) in vec3 fn1;
layout(location = 4) in vec4 vcolor;
uniform mat4 _worldToClip;

out vec4 vs_color;
out vec3 vs_position0;
out vec3 vs_position1;
out vec3 vs_normal0;
out vec3 vs_normal1;

void main() 
{
  vs_position0 = pos0;
  vs_position1 = pos1;
  vs_normal0 = fn0;
  vs_normal1 = fn1;
  vs_color = vcolor;
}""",
    glLineWidth=4,
    glPointSize=8)
